# Grasshopper definition pulseSensor.gh (Grasshopper 0.9.76)

crv = Curve(<curve referenced from the Rhino model>)
area = Area(Geometry=crv)  # -> Area, Centroid
boundary = BoundarySurfaces(Edges=crv)
scale = Scale(Geometry=boundary, Center=area.Centroid, Factor=Slider(0.3, range=0..1))  # -> Geometry, Transform
divide = DivideCurve(Curve=crv, Count=Slider(18, range=0..100), Kinks=False)  # -> Points, Tangents, Parameters
popgeo = PopulateGeometry(Geometry=scale.Geometry, Count=Slider(7, range=0..100), Seed=Slider(309, range=0..1000))
del = DelaunayMesh(Points=[popgeo, divide.Points], Plane=PlaneXY(0, 0, 0))
faceb = FaceBoundaries(Mesh=del)
area_2 = Area(Geometry=faceb)  # -> Area, Centroid
scale_2 = Scale(Geometry=faceb, Center=area_2.Centroid, Factor=Slider(0.72, range=0..1))  # -> Geometry, Transform
fillet = Fillet(Curve=scale_2.Geometry, Radius=Slider(0.352, range=0..1))
crv_2 = Curve(flatten([crv, fillet]))
panel = Panel(crv_2)
boundary_2 = BoundarySurfaces(Edges=crv_2)
Z = UnitZ(Factor=Slider(1.2, range=0..10))
extr = Extrude(Base=boundary_2, Direction=Z)
eval = EvaluateLength(Normalized=True)  # -> Point, Tangent, Parameter
